# Grasshopper definition ECOM_toolkit.gh (Grasshopper 1.0.8)

transformer = DFTransformer()  # -> transformer; disabled; plug-in component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
runopendss = DFRunOpenDSS()  # -> out, buildings, connectors, transformers; disabled; plug-in component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
elecconnect = DFElectricalConnector()  # -> connector; disabled; plug-in component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
substation = DFSubstation()  # -> substation; disabled; plug-in component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
network = DFElectricalNetwork()  # -> out, network; disabled; plug-in component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

fixedintervalschedule = HBFixedIntervalSchedule()  # -> out, schedule; disabled; plug-in component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
weeklyschedule = HBWeeklySchedule()  # -> out, schedule, idf_year, idf_week, idf_days; disabled; plug-in component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

pvmodule = PVModule(
    name="Default 400W Panel",
    rating=Slider(400, range=0..1000),
    size_x=Slider(1, range=0..1),
    size_y=Slider(2, range=0..10),
    cost=Slider(3100, range=0..10000),
    embodied_co2=Slider(615, range=0..1000))  # -> out, PV_module, efficiency, area, total_cost, total_embodied_co2
# ---------- pvmodule: Python ----------
#! python3
# r: pandas, numpy, networkx

ghenv.Component.Name = 'PVModule'
ghenv.Component.NickName = 'PVModule'
ghenv.Component.Message = '0.0.1'
ghenv.Component.Category = 'ECOM4Future'
ghenv.Component.SubCategory = '1 :: Entities'
ghenv.Component.AdditionalHelpFromDocStrings = '2'

from ECOMToolkit.entities import PVModule
# --- Main Grasshopper Logic ---
PV_module = PVModule(name, rating, size_x, size_y, cost, embodied_co2)
report = PV_module.validate()
efficiency = PV_module.efficiency
area = PV_module.area
total_cost = PV_module.total_cost
total_embodied_co2 = PV_module.total_embodied_co2
# ---------- end pvmodule ----------
panel = Panel(pvmodule.PV_module)

value_list = ValueList({"SE1", "SE2", "SE3", "SE4"}, selected="SE3")
value_list_2 = ValueList({"EUR", "SEK"}, selected="SEK")
nordpool_price = NordPoolPriceFetcher(delivery_area=value_list, start_date="2025-07-20", end_date="2025-07-21", currency=value_list_2)  # -> out, timestamps, prices, price_df, avg_price, min_price, max_price
# ---------- nordpool_price: Python ----------
#! python3
# r: numpy, pandas
import numpy as np
import pandas as pd
# Nord Pool Multi-Day Price Fetcher (MIT)
# Version: 0.0.4
# Designed for Grasshopper (GH) by ECOM4Future

"""
Fetch hourly day-ahead electricity prices from Nord Pool for a date range.

    Args:
        delivery_area: Price area (e.g., "SE3").
        start_date: Start date (YYYY-MM-DD).
        end_date: End date (YYYY-MM-DD).
        currency: Currency (default "SEK").

    Returns:
        report: Summary of fetched data.
        timestamps: List of hourly timestamps (string).
        prices: List of hourly prices (SEK/kWh).
        avg_price: Average hourly price.
        min_price: Minimum hourly price.
        max_price: Maximum hourly price.
        price_df: List of dictionaries [{timestamp: ..., price: ...}]
"""

ghenv.Component.Name = 'Nord Pool Price Fetcher'
ghenv.Component.NickName = 'nordpool_price'
ghenv.Component.Message = '0.0.1'
ghenv.Component.Category = 'ECOM4Future'
ghenv.Component.SubCategory = '5 :: Energy Community'
ghenv.Component.AdditionalHelpFromDocStrings = '2'

import json
import System
from System.Net import WebClient
from System import DateTime

try:
    from ladybug_rhino.grasshopper import all_required_inputs
except ImportError:
    def all_required_inputs(comp): return True


class NordPoolPriceFetcher:
    BASE_URL = "https://dataportal-api.nordpoolgroup.com/api/DayAheadPrices"

    def __init__(self, delivery_area, start_date, end_date, currency="SEK"):
        self.delivery_area = delivery_area
        self.currency = currency
        self.start_date = DateTime.Parse(start_date)
        self.end_date = DateTime.Parse(end_date)

        self.timestamps, self.prices = self._fetch_multiple_days()

    def _fetch_multiple_days(self):
        ts, ps = [], []
        wc = WebClient()

        current = self.start_date
        while current <= self.end_date:
            date_str = current.ToString("yyyy-MM-dd")
            url = "{}?date={}&market=DayAhead&deliveryArea={}&currency={}".format(
                self.BASE_URL, date_str, self.delivery_area, self.currency
            )

            try:
                response = wc.DownloadString(url)
                data = json.loads(response)
                entries = data.get("multiAreaEntries", [])
            except Exception as e:
                print("Warning: Could not fetch {} ({})".format(date_str, e))
                current = current.AddDays(1)
                continue

            for i, entry in enumerate(entries):
                try:
                    price_mwh = entry["entryPerArea"].get(self.delivery_area)
                    if price_mwh is not None:
                        price_kwh = float(price_mwh) / 1000.0
                        ts.append("{} {:02d}:00".format(date_str, i))
                        ps.append(price_kwh)
                except:
                    continue

            current = current.AddDays(1)

        return ts, ps

    def avg_price(self): return sum(self.prices) / len(self.prices) if self.prices else 0
    def min_price(self): return min(self.prices) if self.prices else 0
    def max_price(self): return max(self.prices) if self.prices else 0

    def price_df(self):
        """Return Pandas DataFrame if available, else list of dicts."""
        try:
            import pandas as pd
            return pd.DataFrame({"timestamp": self.timestamps, "price": self.prices})
        except ImportError:
            return [{"timestamp": t, "price": p} for t, p in zip(self.timestamps, self.prices)]


    def validate(self):
        return ("Fetched {} hourly prices for {} from {} to {} ({}).\n"
                "Avg: {:.3f} {} | Min: {:.3f} | Max: {:.3f}"
                .format(len(self.prices), self.delivery_area,
                        self.start_date.ToString("yyyy-MM-dd"),
                        self.end_date.ToString("yyyy-MM-dd"),
                        self.currency, self.avg_price(),
                        self.currency, self.min_price(), self.max_price()))


# --- Grasshopper Main Logic ---
if all_required_inputs(ghenv.Component):
    fetcher = NordPoolPriceFetcher(delivery_area, start_date, end_date, currency)
    timestamps = fetcher.timestamps
    prices = fetcher.prices
    report = fetcher.validate()
    avg_price = fetcher.avg_price()
    min_price = fetcher.min_price()
    max_price = fetcher.max_price()
    price_df = fetcher.price_df()
# ---------- end nordpool_price ----------
panel_2 = Panel(nordpool_price.prices)
panel_3 = Panel(nordpool_price.price_df)

number_slider = Slider(10, range=0..10)
point = Point(Point(319626.6464, 6398341.684, 0))
battery = Battery(
    name="B01",
    capacity=Slider(54, range=0..100),
    point=point,
    initial_soc=Slider(5, range=0..10),
    cost=number_slider,
    embodied_co2=number_slider,
    efficiency=Slider(20, range=0..100),
    lifespan=Slider(10, range=0..10),
    degradation=Slider(2, range=0..100))  # -> out, battery, total_cost, total_embodied_co2, capacity_eol, capacity_average; inputs point: Point3d
# ---------- battery: Python ----------
# Battery: A Plugin for Energy Storage Analysis (MIT)
# Version: 0.0.2
# Designed for use inside Grasshopper (GH) for Rhino by ECOM4Future

"""
Create a Battery object representing an energy storage system.
_
Calculates total cost, total embodied carbon, and degraded capacity over lifespan.
-

    Args:
        name: Battery name or model identifier.
            Example: "Tesla Powerwall 2".
        capacity: Battery storage capacity (kWh).
            Example: 13.5.
        point: A Rhino point representing the battery location (for visualization).
        cost: Cost per kWh of storage (SEK/kWh).
            Example: 5000.
        embodied_co2: Embodied carbon per kWh of storage (kgCO2e/kWh).
            Example: 120.
        efficiency: Round-trip battery efficiency (%).
            Example: 90.
        lifespan: Expected lifespan (years).
            Example: 15.
        degradation: Annual capacity degradation (%/year, as 0-100).
            Example: 2 (for 2% per year).

    Returns:
        out: Validation message.
        battery: The Battery object.
        total_cost: Total cost of the battery (SEK).
        total_embodied_co2: Total embodied carbon of the battery (kgCO2e).
"""

ghenv.Component.Name = 'Battery'
ghenv.Component.NickName = 'Battery'
ghenv.Component.Message = '0.0.1'
ghenv.Component.Category = 'ECOM4Future'
ghenv.Component.SubCategory = '1 :: Entities'
ghenv.Component.AdditionalHelpFromDocStrings = '2'

import Rhino.Geometry as rg


from ECOMToolkit.entities import Battery
# --- Main Grasshopper Logic ---
if name and capacity and point and cost and embodied_co2 and efficiency and lifespan and degradation is not None:
    battery = Battery(name, capacity, point, cost, embodied_co2, efficiency, lifespan, degradation, initial_soc)
    out = battery.validate()
    total_cost = battery.total_cost
    total_embodied_co2 = battery.total_embodied_co2
    capacity_eol = battery.capacity_eol
    capacity_average = battery.average_capacity
# ---------- end battery ----------
panel_4 = Panel(battery.battery)

value_list_3 = ValueList({"hourly", "fixed", "real_time"}, selected="hourly")
energy_price = EnergyPrice(pricing_mode=value_list_3, hourly_prices=nordpool_price.prices)  # -> out, report, price_data, avg_price, min_price, max_price; inputs hourly_prices: list
# ---------- energy_price: Python ----------
# Energy Price: Flexible Price Definition (MIT)
# Version: 0.0.4
# Designed for use inside Grasshopper (GH) for Rhino by ECOM4Future

"""
Define the electricity price structure for the energy community analysis.
Supports fixed price, hourly list, or real-time/day-ahead prices.

    Args:
        pricing_mode: Select pricing mode:
            - "fixed" = constant price for all hours.
            - "hourly" = list of hourly prices (any length: day, week, year).
            - "real_time" = real-time/day-ahead prices (DataFrame or CSV).
        fixed_price: (Required if mode="fixed")
            Constant electricity price in SEK/kWh. Example: 1.2
        hourly_prices: (Required if mode="hourly")
            A list or GH data tree of hourly prices (SEK/kWh).
        real_time_data: (Required if mode="real_time")
            A CSV file path or Pandas DataFrame with at least:
            ["timestamp", "price"] columns.

    Returns:
        report: Summary of the selected pricing mode and basic stats.
        price_data: Standardized price data (float, list, or DataFrame).
        avg_price: Average electricity price (SEK/kWh).
        min_price: Minimum price (SEK/kWh).
        max_price: Maximum price (SEK/kWh).
"""

ghenv.Component.Name = 'Energy Price'
ghenv.Component.NickName = 'energy_price'
ghenv.Component.Message = '0.0.4'
ghenv.Component.Category = 'ECOM4Future'
ghenv.Component.SubCategory = '5 :: Energy Community'
ghenv.Component.AdditionalHelpFromDocStrings = '2'

import csv, os

try:
    import pandas as pd
except ImportError:
    pd = None

try:
    from ladybug_rhino.grasshopper import all_required_inputs
except ImportError:
    def all_required_inputs(comp): return True  # fallback


class EnergyPrice:
    """Flexible electricity price definition."""

    def __init__(self, pricing_mode, fixed_price=None, hourly_prices=None, real_time_data=None):
        self.mode = pricing_mode.lower().strip()
        self.fixed_price = fixed_price
        self.hourly_prices = hourly_prices
        self.real_time_data = real_time_data
        self.price_data = self._parse_price_data()

    def _parse_price_data(self):
        """Standardize the price data based on the selected mode."""
        if self.mode == "fixed":
            if self.fixed_price is None:
                raise ValueError("Fixed price must be provided when mode='fixed'.")
            return float(self.fixed_price)

        elif self.mode == "hourly":
            # ✅ Convert GH trees/tuples to native Python list
            if self.hourly_prices is None:
                raise ValueError("hourly_prices must be provided when mode='hourly'.")
            if not isinstance(self.hourly_prices, list):
                try:
                    self.hourly_prices = list(self.hourly_prices)
                except Exception:
                    raise ValueError("Could not convert hourly_prices to a valid list.")
            if len(self.hourly_prices) == 0:
                raise ValueError("hourly_prices must be a non-empty list of hourly values.")
            return [float(v) for v in self.hourly_prices]

        elif self.mode == "real_time":
            if not pd:
                raise ImportError("Pandas is required for real_time mode.")
            if isinstance(self.real_time_data, str) and os.path.isfile(self.real_time_data):
                df = pd.read_csv(self.real_time_data)
            elif isinstance(self.real_time_data, pd.DataFrame):
                df = self.real_time_data.copy()
            else:
                raise ValueError("real_time_data must be a CSV path or Pandas DataFrame.")
            if not {"timestamp", "price"}.issubset(df.columns):
                raise ValueError("Real-time data must have 'timestamp' and 'price' columns.")
            df["timestamp"] = pd.to_datetime(df["timestamp"])
            df = df.sort_values("timestamp")
            return df

        else:
            raise ValueError("Invalid pricing_mode. Use 'fixed', 'hourly', or 'real_time'.")

    def avg_price(self):
        if self.mode == "fixed":
            return float(self.fixed_price)
        if self.mode == "hourly":
            return sum(self.hourly_prices) / len(self.hourly_prices)
        if self.mode == "real_time":
            return self.price_data["price"].mean()

    def min_price(self):
        if self.mode == "fixed":
            return float(self.fixed_price)
        if self.mode == "hourly":
            return min(self.hourly_prices)
        if self.mode == "real_time":
            return self.price_data["price"].min()

    def max_price(self):
        if self.mode == "fixed":
            return float(self.fixed_price)
        if self.mode == "hourly":
            return max(self.hourly_prices)
        if self.mode == "real_time":
            return self.price_data["price"].max()

    def validate(self):
        return (f"Energy Price configured successfully (Mode: {self.mode}).\n"
                f"Average: {self.avg_price():.3f} SEK/kWh | "
                f"Min: {self.min_price():.3f} | Max: {self.max_price():.3f}")


# --- Main Grasshopper Logic ---
if all_required_inputs(ghenv.Component):
    price_obj = EnergyPrice(pricing_mode, fixed_price, hourly_prices, real_time_data)
    price_data = price_obj.price_data
    report = price_obj.validate()
    avg_price = price_obj.avg_price()
    min_price = price_obj.min_price()
    max_price = price_obj.max_price()
# ---------- end energy_price ----------
panel_5 = Panel(energy_price.price_data)
panel_6 = Panel("analysis period")

number_slider_2 = Slider(7, range=0..10)
analysisperiod = LBAnalysisPeriod(
    start_month=number_slider_2,
    start_day=Slider(20, range=0..100),
    start_hour=0,
    end_month=number_slider_2,
    end_day=Slider(21, range=0..100))  # -> period, hoys, dates; plug-in component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

panel_7 = Panel("""1
1
0
0
0
1
0
1
0
1
0
1
1
0
0
0
1
0
1
0
1
0
1
1""")
# how much charge did the car come with?
electricvehicle = ElectricVehicle(
    name="EV1",
    schedule=panel_7,
    analysis_period=analysisperiod.hoys,
    capacity=Slider(50, range=0..100),
    is_hybrid=Toggle(False),
    efficiency=Slider(16, range=0..100),
    daily_distance=Slider(20, range=0..100),
    max_charging_power=Slider(2.5, range=0..10),
    v2g_enabled=Toggle(True),
    embodied_co2=Slider(7.3, range=0..10))  # -> out, EV; inputs name: String, schedule: list of Double, analysis_period: list of Int32
# ---------- electricvehicle: Python ----------
# Electric Vehicle: A Plugin for EV Analysis (MIT)
# Version: 0.0.2
# Designed for use inside Grasshopper (GH) for Rhino by ECOM4Future

"""
Create an Electric Vehicle (EV) object compatible with Honeybee schedules.
_

    Args:
        name: EV name or model identifier.
        schedule: A Honeybee schedule (ScheduleRuleset or ScheduleFixedInterval)
            or a constant value/list to define EV availability (0 = away, 1 = available).
        capacity: Battery capacity (kWh).
        is_hybrid: Boolean (True = PHEV, False = BEV).
        efficiency: EV energy consumption (kWh/100 km).
        daily_distance: Average daily driving distance (km/day).
        max_charging_power: Maximum charging power (kW).
        v2g_enabled: Boolean for Vehicle-to-Grid.
        embodied_co2: Battery embodied carbon (kgCO2e/kWh).

    Returns:
        out: Validation message.
        EV: EV object.
        daily_energy_demand: Estimated daily charging demand (kWh/day).
        usable_capacity: Usable battery capacity (kWh).
        total_embodied_co2: Total embodied CO₂ (kgCO2e).
"""

ghenv.Component.Name = 'ElectricVehicle'
ghenv.Component.NickName = 'ElectricVehicle'
ghenv.Component.Message = '0.0.1'
ghenv.Component.Category = 'ECOM4Future'
ghenv.Component.SubCategory = '1 :: Entities'
ghenv.Component.AdditionalHelpFromDocStrings = '2'

import Rhino.Geometry as rg

try:
    from honeybee.schedule.ruleset import ScheduleRuleset
except ImportError:
    ScheduleRuleset = None


from ECOMToolkit.entities import ElectricVehicle

# --- Main Grasshopper Logic ---

EV = ElectricVehicle(
    name, schedule, capacity, is_hybrid,
    efficiency, daily_distance, max_charging_power,
    v2g_enabled, embodied_co2, analysis_period
)
out = EV.validate()
daily_energy_demand = EV.daily_energy_demand
usable_capacity = EV.usable_capacity
total_embodied_co2 = EV.total_embodied_co2
# ---------- end electricvehicle ----------
panel_8 = Panel(electricvehicle.EV)

surface = Surface(<surface referenced from the Rhino model>)
pvplant = PVPlant(
    name="PV Plant 1",
    surfaces=surface,
    PV_module=pvmodule.PV_module,
    percentage=Slider(80, range=0..100),
    system_loss=Slider(14, range=0..100),
    run=Toggle(True))  # -> out, report, PV_plant, azimuth, slope, number_panels, installed_capacity, total_cost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; inputs surfaces: list of Brep
# ---------- pvplant: Python ----------
# PVGIS: A Plugin for PV Plant Production Analysis (MIT)
# Version: 0.1.3
# Designed for use inside Grasshopper (GH) for Rhino by ECOM4Future

ghenv.Component.Name = 'PVPlant'
ghenv.Component.NickName = 'PVPlant'
ghenv.Component.Message = '0.0.1'
ghenv.Component.Category = 'ECOM4Future'
ghenv.Component.SubCategory = '1 :: Entities'
ghenv.Component.AdditionalHelpFromDocStrings = '2'

import pandas as pd
from ECOMToolkit.entities import PVPlant

# --- Grasshopper Main Logic ---
if run and surfaces is not None:
    # Ensure PV_module and percentage are lists matching surfaces
    if not isinstance(PV_module, list):
        PV_module = [PV_module] * len(surfaces)
    elif len(PV_module) != len(surfaces):
        raise ValueError("PV_module list must match surfaces list length.")

    if not isinstance(percentage, list):
        percentage = [percentage] * len(surfaces)
    elif len(percentage) != len(surfaces):
        raise ValueError("Percentage list must match surfaces list length.")

    PV_plant, report = [], []
    slope, azimuth, installed_capacity = [], [], []
    number_panels, total_cost, total_embodied_co2 = [], [], []
    annual_production, hourly_result = [], []
    combined_dfs = []

    for i, srf in enumerate(surfaces):
        plant_name = "{}_{}".format(name_, i + 1) if len(surfaces) > 1 else name_
        plant = PVPlant(
            name=plant_name,
            surface=srf,
            pv_module=PV_module[i],
            percentage=percentage[i],
            system_loss=system_loss,  # now explicitly in %
            lat=lat,
            lon=lon,
            custom_slope=custom_slope
        )

        PV_plant.append(plant)
        report.append(plant.validate())
        slope.append(plant.slope)
        azimuth.append(plant.azimuth)
        installed_capacity.append(plant.installed_capacity)
        number_panels.append(plant.module_count)
        total_cost.append(plant.total_cost)
        total_embodied_co2.append(plant.total_embodied_co2)
        annual_production.append(plant.annual_production)
        hourly_result.append(plant.hourly_result)
        if not plant.hourly_df.empty:
            combined_dfs.append(plant.hourly_df)

    # Combine all hourly DataFrames into one, if any exist
    if combined_dfs:
        hourly_dataframe_combined = pd.concat(combined_dfs, ignore_index=True)
    else:
        hourly_dataframe_combined = pd.DataFrame()
else:
    report = []
    PV_plant = []
    azimuth = []
    slope = []
    number_panels = []
    installed_capacity = []
    total_cost = []
    total_embodied_co2 = []
    annual_production = []
    hourly_dataframes = []
    hourly_dataframe_combined = pd.DataFrame()
# ---------- end pvplant ----------
panel_9 = Panel(pvplant.hourly_result)

# ----
# Make it work with HB building type program
panel_10 = Panel("E:\DT4PED\DT4PED_Campus\GH_Components\ECOMToolkit\data\sample_el_demand.csv")
hb_building_programs = HBBuildingPrograms({"LargeOffice", "MediumOffice", "SmallOffice", "MidriseApartment", "HighriseApartment", "Retail", "StripMall", "PrimarySchool", "SecondarySchool", "SmallHotel", "LargeHotel", "Hospital", "Outpatient", "Laboratory", "Warehouse", "SuperMarket", "FullServiceRestaurant", "QuickServiceRestaurant", "Courthouse", "College", "LargeDataCenterHighITE", "LargeDataCenterLowITE", "SmallDataCenterHighITE", "SmallDataCenterLowITE"}, selected="MidriseApartment")
curve = Curve(<curve referenced from the Rhino model>)
value_list_4 = ValueList({"Akademiska Hus", "Studentbostäder", "Chalmersfastigheter"}, selected="Akademiska Hus")
number_slider_3 = Slider(100, range=0..100)
user_text = UserText(Content=curve, Keys="number_of_floors", UserTextMode=1)  # -> Content, Keys, Values
brep = Brep(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)
building = Building(
    name="B1",
    owner=value_list_4,
    footprints=flatten(user_text.Content),
    number_of_floors=flatten(user_text.Values),
    breps=flatten(brep),
    building_type=hb_building_programs,
    electric_demand=panel_10,
    PV_plant=pvplant.PV_plant)  # -> out, building, area, fractional_hourly_electric_demand, electric_demand_from_program, electric_demand, total_energy_demand, total_installed_capacity; inputs footprints: list of Curve, number_of_floors: list, breps: list
# ---------- building: Python ----------
# Building: Honeybee-Compatible Building Entity (MIT)
# Version: 0.0.7 (Added Owner Input)
# Designed for use inside Grasshopper (GH) for Rhino by ECOM4Future

"""
Create a Honeybee-compatible Building object for energy community simulations.
_

    Args:
        name: Building name or ID (string).
        footprint: Rhino Brep or Surface representing the building footprint or 3D volume.
        building_type: Honeybee building program type (e.g., "MidriseApartment", "SmallOffice").
        occupancy_schedule: Honeybee ScheduleRuleset or ScheduleFixedInterval.
            (Optional) Can be converted to a pandas DataFrame via `convert_schedule_to_df=True`.
        electric_demand: List of 8760 hourly values (kWh), a CSV file path, or annual demand (kWh/year).
        construction_embodied_co2: Embodied CO₂ of construction (kgCO2e/m² or total kgCO2e).
        PV_plant: One or more PV Plant objects (from the PV Plant component).
        Battery: One or more Battery objects (from the Battery component).
        owner: Owner of the building. Must be one of:
            "Akademiska Hus", "Studentbostäder", "Chalmersfastigheter"
        convert_schedule_to_df: (Optional) Boolean to convert schedule to pandas DataFrame.

    Returns:
        report: Validation message.
        building: Building object (to pass into merge component).
        total_energy_demand: Total electric demand (kWh/year).
        total_pv_capacity: Total installed PV capacity (kW).
        total_installed_capacity: Combined PV + battery capacity (kW + kWh).
        total_embodied_co2: Total embodied CO₂ of the building (kgCO2e).
"""

ghenv.Component.Name = 'Building'
ghenv.Component.NickName = 'Building'
ghenv.Component.Message = '0.0.1'
ghenv.Component.Category = 'ECOM4Future'
ghenv.Component.SubCategory = 'Entities'
ghenv.Component.AdditionalHelpFromDocStrings = '2'

from ECOMToolkit.entities import Building
# --- Main Grasshopper Logic ---

building = Building(
    name, footprints, building_type,
    occupancy_schedule, electric_demand, PV_plant,
    owner, convert_schedule_to_df=False, breps=breps,number_of_floors=number_of_floors
)
report = building.validate()
electric_demand = building.electric_demand
total_energy_demand = building.total_energy_demand
total_pv_capacity = building.total_pv_capacity
total_installed_capacity = building.total_installed_capacity
area = building.area
fractional_hourly_electric_demand = building.fractional_hourly_electric_demand
electric_demand_from_program = building.electric_demand_from_program
# ---------- end building ----------
panel_11 = Panel(building.building)
panel_12 = Panel(building.electric_demand_from_program)
panel_13 = Panel(building.electric_demand)
panel_14 = Panel(building.fractional_hourly_electric_demand)

value_list_5 = ValueList({"Akademiska Hus", "Studentbostäder", "Chalmersfastigheter"}, selected="Akademiska Hus")
point_2 = Point(Point(319626.6464, 6398341.684, 0))
chargepoint = ChargePoint(
    name="CP",
    owner=value_list_5,
    point=point_2,
    capacity=Slider(100, range=0..100),
    charger_type="A",
    is_v2g=Toggle(True),
    EV=electricvehicle.EV)  # -> out, charge_point, hourlydemand
# ---------- chargepoint: Python ----------
# Charge Point: A Plugin for EV Charging Infrastructure (MIT)
# Version: 0.0.2 (Added Owner Input)
# Designed for use inside Grasshopper (GH) for Rhino by ECOM4Future

"""
Create a Charge Point object representing an EV charging station.
_

    Args:
        name: Name or identifier of the charging point.
            Example: "CP-01".
        point: Rhino Point3d for charger location.
        capacity: Maximum charging power (kW).
            Example: 11.
        charger_type: Charger type as string (e.g., "AC Level 2", "DC Fast").
        is_v2g: Boolean indicating if V2G is supported.
        EV: One or more Electric Vehicle objects connected to this charger.
        owner: Owner of the charge point. Must be one of:
            "Akademiska Hus", "Studentbostäder", "Chalmersfastigheter"

    Returns:
        report: Validation message.
        charge_point: A Charge Point object.
"""

ghenv.Component.Name = 'ChargePoint'
ghenv.Component.NickName = 'ChargePoint'
ghenv.Component.Message = '0.0.1'
ghenv.Component.Category = 'ECOM4Future'
ghenv.Component.SubCategory = '1 :: Entities'
ghenv.Component.AdditionalHelpFromDocStrings = '2'

import Rhino.Geometry as rg
from typing import List


from ECOMToolkit.entities import ChargePoint

# --- Main Grasshopper Logic ---
if name and point and capacity is not None and charger_type and is_v2g is not None and owner:
    # Ensure EV is always a list
    EV = EV if isinstance(EV, list) else [EV] if EV else []

    charge_point = ChargePoint(name, point, capacity, charger_type, is_v2g, owner, EV)
    report = charge_point.validate()
    hourlydemand = charge_point.hourlydemand
# ---------- end chargepoint ----------
panel_15 = Panel(chargepoint.hourlydemand)

panel_16 = Panel(analysisperiod.hoys)
grid = Grid(
    analysis_period=analysisperiod.hoys,
    electricity_market_selling_price=energy_price.price_data,
    electricity_market_buying_price=energy_price.price_data,
    electricity_market_carbon_intensity=energy_price.price_data)  # -> out, report, grid; inputs analysis_period: list of Int32, electricity_market_selling_price: list, electricity_market_buying_price: list, electricity_market_carbon_intensity: list
# ---------- grid: Python ----------
# Grid: Energy Community Grid Connection (MIT)
# Version: 0.0.1
# Designed for use inside Grasshopper (GH) for Rhino by ECOM4Future

"""
Compute annual electricity balance for a Grid connection, compatible with Dragonfly.
_

    Args:
        name: Name or ID of the grid connection.
        substation: Dragonfly Substation object.
        connector: List of Dragonfly ElectricalConnector objects.
        transformer: List of Dragonfly Transformer objects.
        capacity: Maximum grid connection capacity (kW).
        building: List of Building objects (from Building component).
        charge_point: List of Charge Point objects (with EVs).
        cost_electricity: Import tariff (SEK/kWh).
        tarriffs: Export tariff (SEK/kWh).
        co2: Grid operational CO₂ factor (kgCO₂e/kWh).
        system_loss: Percentage loss in transformers/connectors (%).

    Returns:
        report: Validation message and summary of the grid balance.
        grid: Grid object (to merge component).
        electricity_import: Total imported electricity (kWh/year).
        electricity_export: Total exported electricity (kWh/year).
        total_cost: Annual grid cost (SEK/year).
        total_co2: Annual operational CO₂ emissions (kgCO₂e/year).
"""

ghenv.Component.Name = 'Grid'
ghenv.Component.NickName = 'Grid'
ghenv.Component.Message = '0.0.1'
ghenv.Component.Category = 'ECOM4Future'
ghenv.Component.SubCategory = '5 :: Energy Community'
ghenv.Component.AdditionalHelpFromDocStrings = '2'

try:
    from honeybee.typing import clean_ep_string
except ImportError:
    def clean_ep_string(value): return str(value)

try:
    from ladybug_rhino.grasshopper import all_required_inputs
except ImportError:
    def all_required_inputs(comp): return True  # fallback


from ECOMToolkit.entities import Grid

# --- Main Grasshopper Logic ---
if all_required_inputs(ghenv.Component):
    grid = Grid(electricity_market_buying_price,
                 electricity_market_selling_price,
                 electricity_market_carbon_intensity,
                 analysis_period)
    report = grid.report()
# ---------- end grid ----------
panel_17 = Panel(grid.grid)
number_slider_4 = Slider(0.45, range=0..1)  # disabled
number_slider_5 = Slider(0.3, range=0..1)  # disabled
number_slider_6 = Slider(0.25, range=0..1)  # disabled
merge = Merge(Data1=number_slider_4, Data2=number_slider_6, Data3=number_slider_5)  # disabled
number_slider_7 = Slider(0.2, range=0..1)  # disabled
number_slider_8 = Slider(0.3, range=0..1)  # disabled
value_list_6 = ValueList({"Community": "community", "Market": "market", "Custom": "custom"}, selected="Community")  # disabled
panel_18 = Panel("0.45,0.25,0.30")  # disabled

energycommunity = EnergyCommunity(building=building.building, battery=battery.battery, charge_point=chargepoint.charge_point, grid=grid.grid)  # -> out, community
# ---------- energycommunity: Python ----------
# Merge ECOM Entities: Energy Community Aggregator (MIT)
# Version: 0.0.3
# Designed for use inside Grasshopper (GH) for Rhino by ECOM4Future

"""
Merge all energy community entities into a single Energy Community object.
_

    Args:
        buildings: List of Building objects.
        PV_plants: (Optional) List of standalone PV Plant objects not linked to buildings.
        Battery: (Optional) List of standalone Battery objects not linked to buildings.
        charging_points: (Optional) List of Charging Point objects (with EVs already linked).
        grid_name: Name or ID of the grid connection.
        grid_capacity: Maximum grid connection capacity (kW).
        grid_tariff: Optional grid tariff or cost (SEK/kWh).

    Returns:
        report: Validation message summarizing counts of each entity.
        community: Energy Community object (dictionary-like) to be used in "create ECOM".
"""

ghenv.Component.Name = 'EnergyCommunity'
ghenv.Component.NickName = 'EnergyCommunity'
ghenv.Component.Message = '0.0.1'
ghenv.Component.Category = 'ECOM4Future'
ghenv.Component.SubCategory = '1 :: Entities'
ghenv.Component.AdditionalHelpFromDocStrings = '2'

from ECOMToolkit.entities import EnergyCommunity


# --- Main Grasshopper Logic ---
community = EnergyCommunity(building,PV_plant,battery,charge_point, None)
# ---------- end energycommunity ----------
panel_19 = Panel(energycommunity.community)

boolean_toggle = BooleanToggle(True)  # disabled
panel_20 = Panel("2025-07-20")  # disabled
ecom_analysis = ECOMAnalysis(community=energycommunity.community, price_data=energy_price.price_data, analysis_period=panel_20, run=boolean_toggle)  # -> out, report, houly_balance, grid_import, grid_export, total_cost, flatten(battery_soc); inputs price_data: list; disabled
# ---------- ecom_analysis: Python ----------
#! python3
# r: numpy, pandas
import numpy as np
import pandas as pd
# ECOM Analysis: Energy Balance Simulation (MIT)
# Version: 0.0.4 (Input Length Validation + Run Toggle)
# Designed for use inside Grasshopper (GH) for Rhino by ECOM4Future

"""
Simulate energy flows in an Energy Community based on PV, battery, and grid.

Dispatch Logic (hourly):
1) PV → Direct Demand (distance priority: closest entities first)
2) PV → Battery Charging (if surplus PV)
3) Battery → Discharge (if PV insufficient for demand)
4) Grid → Import (last resort)

    Args:
        run: Boolean toggle to start/stop simulation.
        community: Energy Community object (from Merge ECOM Entities).
        price_data: Electricity price (float, list, or pandas Series/DataFrame).
        analysis_period: Optional [start_hour, end_hour] range (0–8759).

    Returns:
        report: Summary of self-consumption, self-sufficiency, cost.
        hourly_balance: Pandas DataFrame with columns:
            ['hour', 'pv_used', 'battery_charge', 'battery_discharge', 'grid_import', 'grid_export', 'soc']
        grid_import: Total grid import (kWh).
        grid_export: Total grid export (kWh).
        total_cost: Total cost of grid imports (SEK).
        battery_soc: Hourly battery state of charge (list).
"""

ghenv.Component.Name = 'ECOM Analysis'
ghenv.Component.NickName = 'ECOM_analysis'
ghenv.Component.Message = '0.0.4'
ghenv.Component.Category = 'ECOM4Future'
ghenv.Component.SubCategory = '5 :: Energy Community'
ghenv.Component.AdditionalHelpFromDocStrings = '2'

try:
    from ladybug_rhino.grasshopper import all_required_inputs
except ImportError:
    def all_required_inputs(comp): return True


class ECOMAnalysis:
    """Vectorized energy balance simulation for the Energy Community."""

    def __init__(self, community, price_data, analysis_period=None):
        self.community = community
        self.price_data = self._prepare_price_data(price_data)
        self.start_hour, self.end_hour = self._prepare_period(analysis_period)

        # Build demand & PV profiles BEFORE validation
        self.total_demand_profile = self._build_demand_profile()
        self.pv_profile = self._get_hourly_pv()

        # ✅ Validate and align all input lengths
        self._validate_and_crop_lengths()

        self.hours = np.arange(self.start_hour, self.start_hour + len(self.total_demand_profile))
        self.n_hours = len(self.hours)

        # Battery capacities
        self.battery_capacities = np.array(self._get_battery_capacities())
        self.soc = np.zeros((self.n_hours, len(self.battery_capacities)))

        # Simulation results
        self.results = pd.DataFrame(index=self.hours,
                                    columns=["pv_used", "battery_charge", "battery_discharge",
                                             "grid_import", "grid_export", "soc"],
                                    data=0.0)

        # Totals
        self.total_grid_import = 0.0
        self.total_grid_export = 0.0
        self.total_cost = 0.0

    def _prepare_price_data(self, price):
        if isinstance(price, (int, float)):
            return np.full(8760, float(price))
        elif isinstance(price, list):
            return np.array(price)
        elif isinstance(price, pd.Series):
            return price.values
        elif isinstance(price, pd.DataFrame) and "price" in price.columns:
            return price["price"].values
        else:
            raise TypeError("Price must be float, list, Series, or DataFrame with 'price' column.")

    def _prepare_period(self, period):
        if period and len(period) == 2:
            return max(0, period[0]), min(period[1], 8759)
        return 0, 8759

    def _build_demand_profile(self):
        profile = np.zeros(8760)
        for b in self.community.building:
            if isinstance(b.electric_demand, list) and len(b.electric_demand) == 8760:
                profile += np.array(b.electric_demand)
            else:
                profile += np.full(8760, b.total_energy_demand / 8760.0)
        return profile[self.start_hour:self.end_hour + 1]

    def _calc_total_pv_gen(self):
        total = 0.0
        for b in self.community.building:
            total += b.total_installed_capacity
        for pv in self.community.PV_plant:
            total += pv.capacity
        return total

    def _get_hourly_pv(self):
        return np.full(self.end_hour - self.start_hour + 1, self._calc_total_pv_gen() / 8760.0)

    def _get_battery_capacities(self):
        caps = []
        for b in self.community.building:
            for bat in getattr(b, "Battery", []):
                caps.append(bat.capacity)
        for bat in self.community.battery:
            caps.append(bat.capacity)
        return caps if caps else [0]

    def _validate_and_crop_lengths(self):
        """✅ Ensure all arrays have the same length; fallback to lowest common length."""
        lengths = [len(self.price_data), len(self.total_demand_profile), len(self.pv_profile)]
        min_len = min(lengths)

        if len(self.price_data) != min_len:
            self.price_data = self.price_data[:min_len]
        if len(self.total_demand_profile) != min_len:
            self.total_demand_profile = self.total_demand_profile[:min_len]
        if len(self.pv_profile) != min_len:
            self.pv_profile = self.pv_profile[:min_len]

    def run(self):
        soc = np.zeros(len(self.battery_capacities))

        for idx, hour in enumerate(self.hours):
            demand = self.total_demand_profile[idx]
            pv_available = self.pv_profile[idx]

            pv_used, battery_charge, battery_discharge, grid_import, grid_export = 0, 0, 0, 0, 0

            # 1) PV to Demand
            if pv_available >= demand:
                pv_used = demand
                pv_available -= demand
                demand = 0
            else:
                pv_used = pv_available
                demand -= pv_available
                pv_available = 0

            # 2) PV to Battery
            if pv_available > 0:
                for i, cap in enumerate(self.battery_capacities):
                    room = cap - soc[i]
                    if room > 0:
                        charge = min(pv_available, room)
                        soc[i] += charge
                        battery_charge += charge
                        pv_available -= charge
                        if pv_available <= 0:
                            break

            # 3) Battery Discharge
            if demand > 0:
                for i, _ in enumerate(self.battery_capacities):
                    if soc[i] > 0:
                        discharge = min(demand, soc[i])
                        soc[i] -= discharge
                        battery_discharge += discharge
                        demand -= discharge
                        if demand <= 0:
                            break

            # 4) Grid Import
            if demand > 0:
                grid_import = demand
                self.total_grid_import += grid_import
                self.total_cost += grid_import * self.price_data[idx]

            # Grid Export
            if pv_available > 0:
                grid_export = pv_available
                self.total_grid_export += grid_export

            self.results.loc[hour] = [pv_used, battery_charge, battery_discharge,
                                      grid_import, grid_export, soc.sum()]
            self.soc[idx, :] = soc

    def validate(self):
        total_demand = self.results["pv_used"].sum() + self.results["battery_discharge"].sum() + self.results["grid_import"].sum()
        self_sufficiency = 100 * (1 - self.total_grid_import / total_demand) if total_demand > 0 else 0
        self_consumption = 100 * ((self._calc_total_pv_gen() - self.total_grid_export) / self._calc_total_pv_gen()) if self._calc_total_pv_gen() > 0 else 0
        return (f"ECOM Analysis complete.\n"
                f"Total Demand: {total_demand:.1f} kWh | Grid Import: {self.total_grid_import:.1f} kWh | Grid Export: {self.total_grid_export:.1f} kWh\n"
                f"Self-Sufficiency: {self_sufficiency:.1f}% | Self-Consumption: {self_consumption:.1f}% | Total Cost: {self.total_cost:.1f} SEK")


# --- Grasshopper Main Logic ---
if all_required_inputs(ghenv.Component) and run:
    analysis = ECOMAnalysis(community, price_data, analysis_period)
    analysis.run()

    report = analysis.validate()
    hourly_balance = analysis.results.to_dict("records")  # GH-friendly
    grid_import = analysis.total_grid_import
    grid_export = analysis.total_grid_export
    total_cost = analysis.total_cost
    battery_soc = analysis.soc
else:
    report = "Toggle 'run' to True to execute the analysis."
    hourly_balance, grid_import, grid_export, total_cost, battery_soc = [], 0, 0, 0, []
# ---------- end ecom_analysis ----------
panel_21 = Panel(ecom_analysis.report)  # disabled

python_3_script = Python3Script(community=energycommunity.community, mode=value_list_6, threshold_sell=number_slider_7, threshold_buy=number_slider_8)  # -> out, report, dispatch_mode; disabled
# ---------- python_3_script: Python ----------
"""
Inputs:
    mode: string ("market", "community", "custom")
    weights: list of 3 floats [w_local, w_battery, w_grid] (optional, use Merge for 3 sliders)
    threshold_sell: float (optional, defaults based on mode)
    threshold_buy: float (optional, defaults based on mode)
Outputs:
    dispatch_mode: an object containing the selected dispatch strategy
    report: text report summarizing weights and thresholds
"""

# --- Default Values in SEK ---
DEFAULTS = {
    "market": {
        "weights": [0.2, 0.3, 0.5],      # prioritize selling
        "threshold_sell": 0.60,          # ~0.6 SEK/kWh typical feed-in
        "threshold_buy": 0.50            # ~0.5 SEK/kWh low-price buy trigger
    },
    "community": {
        "weights": [0.8, 0.15, 0.05],    # prioritize local use
        "threshold_sell": 1.00,          # only sell when price is very high
        "threshold_buy": 0.30            # buy cheaply if possible
    }
}

# --- Base Class ---
class DispatchMode:
    def dispatch(self, community_state):
        raise NotImplementedError("Implement in subclass.")

# --- Parametric Dispatch Class ---
class ParametricDispatch(DispatchMode):
    def __init__(self, mode_name, weights, threshold_sell, threshold_buy):
        # Flatten GH-style nested lists if needed
        if isinstance(weights, (tuple, list)) and len(weights) == 1 and isinstance(weights[0], (list, tuple)):
            weights = weights[0]

        if weights is None or len(weights) != 3:
            raise ValueError("Weights must be a list of exactly 3 numbers.")

        # Store values (convert everything to float)
        self.mode_name = mode_name
        self.w_local, self.w_battery, self.w_grid = [float(w) for w in weights]
        self.threshold_sell = float(threshold_sell)
        self.threshold_buy = float(threshold_buy)

    def dispatch(self, community_state):
        # Placeholder – actual logic will be in the ECOM dispatcher
        return {}

    def report(self):
        return f"""
Dispatch Mode Report
====================
Mode: {self.mode_name.capitalize()}
Priority Weights:
  - Local Consumption: {self.w_local:.2f}
  - Battery Charging:  {self.w_battery:.2f}
  - Grid Export:       {self.w_grid:.2f}

Thresholds:
  - Sell to Grid if Price >= {self.threshold_sell:.2f} SEK/kWh
  - Buy from Grid if Price <= {self.threshold_buy:.2f} SEK/kWh
"""

# --- Factory Function ---
def create_dispatch_mode(mode, weights=None, threshold_sell=None, threshold_buy=None):
    m = str(mode).lower().strip()

    # Convert thresholds to float if provided
    ts = float(threshold_sell) if threshold_sell not in (None, "") else None
    tb = float(threshold_buy) if threshold_buy not in (None, "") else None

    if m in DEFAULTS.keys() and (weights is None or len(weights) == 0):
        w = DEFAULTS[m]["weights"]
        ts = ts if ts is not None else DEFAULTS[m]["threshold_sell"]
        tb = tb if tb is not None else DEFAULTS[m]["threshold_buy"]
        return ParametricDispatch(m, w, ts, tb)

    elif m == "custom" and weights is not None and len(weights) == 3:
        ts = ts if ts is not None else 0.6
        tb = tb if tb is not None else 0.5
        return ParametricDispatch(m, weights, ts, tb)

    else:
        raise ValueError("Invalid mode or missing/incorrect weights for custom mode.")

# --- RUN ---
dispatch_mode = create_dispatch_mode(mode, weights, threshold_sell, threshold_buy)
report = dispatch_mode.report()
# ---------- end python_3_script ----------
panel_22 = Panel(python_3_script.report)  # disabled

number_slider_9 = Slider(14, range=0..100)
number_slider_10 = Slider(0.22, range=0..1)
number_slider_11 = Slider(0.2, range=0..1)
value_list_7 = ValueList({"Community": "community", "Market": "market"}, selected="Community")
ecom_dispatcher = ECOMDispatcher(
    community=energycommunity.community,
    dispatch_mode=value_list_7,
    analysis_period=analysisperiod.hoys,
    community_internal_price_selling=number_slider_10,
    community_internal_price_buying=number_slider_10,
    run=Toggle(True))  # -> out, report, hourly_dispatch, grid_import, grid_export, total_cost, total_revenue, battery_soc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; inputs analysis_period: list of Int32
# ---------- ecom_dispatcher: Python ----------
# ECOM Dispatcher: Peer-to-Peer (P2P) and Peer-to-Grid (P2G) Energy Trade Simulation
# Version: 0.1.0 (Refactored for readability, added clean hourly dispatch outputs)
# Designed for use inside Grasshopper (GH) for Rhino by ECOM4Future

"""
Simulate hourly energy dispatch in an Energy Community.

Dispatch Sequence:
    1. Building self-consumption (own photovoltaic).
    2. Peer-to-peer exchange between buildings (P2P).
    3. Community PV used to cover remaining deficits.
    4. Building and community batteries discharge.
    5. Grid imports cover remaining deficits.
    6. Surplus charges batteries if capacity available.
    7. Remaining surplus exported to the grid.

Args:
    run (bool): Toggle to execute simulation.
    community: Energy Community object (from Merge ECOM Entities).
    community_internal_price_buying (float): Price for internal community trades (buying, SEK/kWh).
    community_internal_price_selling (float): Price for internal community trades (selling, SEK/kWh).
    electricity_market_price (float, list, CSV): Market electricity price.
    electricity_market_carbon_intensity (float, list, CSV): Grid carbon intensity (gCO₂/kWh).
    dispatch_mode (str): "community" (P2P prioritized) or "market" (optimized for price).
    analysis_period (tuple): Optional [start_hour, end_hour] (0–8759).

Returns:
    report (str): Text summary of self-sufficiency, self-consumption, cost, revenue, and carbon.
    hourly_dispatch (list[dict]): Hourly flows, e.g.,
        [{"hour": 0, "pv_used": 1.2, "p2p_energy": 0.5,
          "battery_charge": 0.3, "battery_discharge": 0.0,
          "grid_import": 2.1, "grid_export": 0.0,
          "soc": {...}}]
    grid_import (float): Total grid import (kWh).
    grid_export (float): Total grid export (kWh).
    total_cost (float): Total grid cost (SEK) – if available.
    total_revenue (float): Total revenue from P2P/P2G trades (SEK) – if available.
    total_carbon_imported (float): Total CO₂ emissions from grid imports (kgCO₂) – if available.
    battery_soc (dict): Hourly state of charge for all batteries.
    scenario (dict): Summary dictionary for scenario comparison.
    kpis (object): KPIResult object with all metrics.
    graph (object): NetworkX graph of the energy flows.
"""

ghenv.Component.Name = 'ECOM Dispatcher'
ghenv.Component.NickName = 'ECOM_dispatcher'
ghenv.Component.Message = '0.0.5'
ghenv.Component.Category = 'ECOM4Future'
ghenv.Component.SubCategory = '5 :: Energy Community'
ghenv.Component.AdditionalHelpFromDocStrings = '2'

from ECOMToolkit.analysis import ECOMDispatcher

# --- Instantiate dispatcher ---
dispatcher = ECOMDispatcher(
    community=community,
    dispatch_mode=dispatch_mode,
    analysis_period=analysis_period,
    community_internal_price_buying=community_internal_price_buying,
    community_internal_price_selling=community_internal_price_selling
)

def safe_getattr(obj, attr, default):
    try:
        return getattr(obj, attr, default)
    except Exception:
        return default

# --- Grasshopper Main Logic ---
if run:
    dispatcher.run()
    kpis = dispatcher.get_kpis()  # KPIResult object

    # Hourly dispatch as list of dicts
    try:
        hourly_dispatch = dispatcher.get_hourly_dispatch()
    except AttributeError:
        hourly_dispatch = []

    # Battery SoC (if available)
    try:
        battery_soc = dispatcher.get_battery_soc()
    except AttributeError:
        battery_soc = {}

    # Cost, revenue, carbon (if available in dispatcher or KPIs)
    total_cost = safe_getattr(kpis, "total_cost", 0.0)
    total_revenue = safe_getattr(kpis, "total_revenue", 0.0)
    total_carbon_imported = safe_getattr(kpis, "total_carbon_imported", safe_getattr(kpis, "total_grid_carbon_import", 0.0))

    # Individual KPIs for GH outputs
    grid_import = safe_getattr(kpis, "total_grid_import", 0.0)
    grid_export = safe_getattr(kpis, "total_grid_export", 0.0)

    # Scenario summary with extended metrics
    scenario = {
        "dispatch_mode": dispatcher.dispatch_mode,
        "grid_import": grid_import,
        "grid_export": grid_export,
        "self_sufficiency": safe_getattr(kpis, "self_sufficiency", 0.0),
        "self_consumption": safe_getattr(kpis, "self_consumption", 0.0),
        "total_pv_used": safe_getattr(kpis, "total_pv_used", 0.0),
        "total_pv_gen": safe_getattr(kpis, "total_pv_gen", 0.0),
        "total_demand": safe_getattr(kpis, "total_demand", 0.0),
        "avg_grid_carbon_intensity": safe_getattr(kpis, "avg_grid_carbon_intensity", None),
        "total_grid_carbon_import": safe_getattr(kpis, "total_grid_carbon_import", None),
        "avg_grid_price_import": safe_getattr(kpis, "avg_grid_price_import", None),
        "avg_building_self_consumption": safe_getattr(kpis, "avg_building_self_consumption", None),
        "building_self_consumption": safe_getattr(kpis, "building_self_consumption", None),
        "total_cost": total_cost,
        "total_revenue": total_revenue,
        "total_carbon_imported": total_carbon_imported
    }

    report = dispatcher.report()
    graph = dispatcher.G

else:
    report = "Toggle 'run' to True to execute the dispatch simulation."
    hourly_dispatch = []
    grid_import = 0.0
    grid_export = 0.0
    total_cost = 0.0
    total_revenue = 0.0
    total_carbon_imported = 0.0
    battery_soc = {}
    scenario = {}
    kpis = None
    graph =None
# ---------- end ecom_dispatcher ----------
panel_23 = Panel(ecom_dispatcher.report)

panel_24 = Panel("DISPATCH COMMUNITY ")  # disabled
panel_25 = Panel("DISPATCH MARKET")  # disabled

boolean_toggle_2 = BooleanToggle(False)  # disabled
ecom_self_sufficiency = ECOMSelfSufficiencyAnalysis(community=energycommunity.community, run=boolean_toggle_2)  # -> out, report, self_sufficiency, self_consumption, grid_import, grid_export; disabled
# ---------- ecom_self_sufficiency: Python ----------
# ECOM Self-Sufficiency Analysis (MIT)
# Version: 0.0.1
# Designed for use inside Grasshopper (GH) for Rhino by ECOM4Future

"""
Calculate self-sufficiency and self-consumption rates for the energy community.

    Args:
        run: Boolean toggle to start/stop analysis.
        community: Energy Community object (from Merge ECOM Entities).
        analysis_period: Optional [start_hour, end_hour] range (0–8759).

    Returns:
        report: Summary of key indicators.
        hourly_metrics: List of dictionaries per hour:
            {hour, demand, pv_generation, battery_discharge, grid_import, grid_export}.
        self_sufficiency: (%) Share of demand met by PV + battery.
        self_consumption: (%) Share of PV generation consumed locally.
        grid_import: Total grid import (kWh).
        grid_export: Total grid export (kWh).
"""

ghenv.Component.Name = 'ECOM Self-Sufficiency Analysis'
ghenv.Component.NickName = 'ECOM_self_sufficiency'
ghenv.Component.Message = '0.0.1'
ghenv.Component.Category = 'ECOM4Future'
ghenv.Component.SubCategory = '6 :: Analysis'
ghenv.Component.AdditionalHelpFromDocStrings = '2'

import numpy as np
import pandas as pd

try:
    from ladybug_rhino.grasshopper import all_required_inputs
except ImportError:
    def all_required_inputs(comp): return True


class SelfSufficiencyAnalysis:
    def __init__(self, community, analysis_period=None):
        self.community = community
        self.start_hour, self.end_hour = self._prepare_period(analysis_period)
        self.hours = np.arange(self.start_hour, self.end_hour + 1)
        self.n_hours = len(self.hours)

        self.total_demand = self._build_demand_profile()
        self.total_pv_gen = self._build_pv_profile()
        self.battery_discharge = self._estimate_battery_discharge()

        self.grid_import = 0.0
        self.grid_export = 0.0
        self.hourly = []

    def _prepare_period(self, period):
        if period and len(period) == 2:
            return max(0, period[0]), min(period[1], 8759)
        return 0, 8759

    def _build_demand_profile(self):
        profile = np.zeros(8760)
        for b in self.community.building:
            if isinstance(b.electric_demand, list) and len(b.electric_demand) == 8760:
                profile += np.array(b.electric_demand)
            else:
                profile += np.full(8760, b.total_energy_demand / 8760.0)
        return profile[self.start_hour:self.end_hour + 1]

    def _build_pv_profile(self):
        total_pv = 0.0
        for b in self.community.building:
            total_pv += b.total_pv_capacity
        for pv in self.community.PV_plant:
            total_pv += pv.capacity
        return np.full(self.n_hours, total_pv * 1000 / 8760.0)  # convert kW → hourly kWh (flat est.)

    def _estimate_battery_discharge(self):
        total_discharge = np.zeros(self.n_hours)
        bat_caps = []
        for b in self.community.building:
            for bat in getattr(b, "battery", []):
                bat_caps.append(bat.capacity)
        for bat in self.community.battery:
            bat_caps.append(bat.capacity)

        if not bat_caps:
            return total_discharge

        # Simple discharge estimation: use 30% of total battery capacity daily distributed evenly
        total_bat_capacity = sum(bat_caps)
        avg_daily_discharge = total_bat_capacity * 0.3 / 24.0
        return np.full(self.n_hours, avg_daily_discharge)

    def run(self):
        for i, hour in enumerate(self.hours):
            demand = self.total_demand[i]
            pv_gen = self.total_pv_gen[i]
            bat_discharge = min(demand, self.battery_discharge[i])
            demand_after_bat = demand - bat_discharge

            if pv_gen >= demand_after_bat:
                pv_used = demand_after_bat
                self.grid_export += pv_gen - pv_used
                grid_import = 0.0
            else:
                pv_used = pv_gen
                grid_import = demand_after_bat - pv_gen
                self.grid_import += grid_import

            self.hourly.append({
                "hour": int(hour),
                "demand": float(demand),
                "pv_generation": float(pv_gen),
                "battery_discharge": float(bat_discharge),
                "grid_import": float(grid_import),
                "grid_export": float(max(0, pv_gen - pv_used))
            })

    def validate(self):
        total_demand = np.sum(self.total_demand)
        pv_used_total = sum(h["pv_generation"] - h["grid_export"] for h in self.hourly)
        self_sufficiency = 100 * (1 - self.grid_import / total_demand) if total_demand > 0 else 0
        self_consumption = 100 * (pv_used_total / np.sum(self.total_pv_gen)) if np.sum(self.total_pv_gen) > 0 else 0

        return (f"Self-Sufficiency Analysis complete.\n"
                f"Total Demand: {total_demand:.1f} kWh | Grid Import: {self.grid_import:.1f} kWh | "
                f"Grid Export: {self.grid_export:.1f} kWh\n"
                f"Self-Sufficiency: {self_sufficiency:.1f}% | Self-Consumption: {self_consumption:.1f}%"), \
               self_sufficiency, self_consumption


# --- Grasshopper Main Logic ---
if all_required_inputs(ghenv.Component) and run:
    analysis = SelfSufficiencyAnalysis(community, analysis_period)
    analysis.run()

    report, self_sufficiency, self_consumption = analysis.validate()
    hourly_metrics = analysis.hourly
    grid_import = analysis.grid_import
    grid_export = analysis.grid_export
else:
    report = "Toggle 'run' to True to execute analysis."
    hourly_metrics, self_sufficiency, self_consumption, grid_import, grid_export = [], 0, 0, 0, 0
# ---------- end ecom_self_sufficiency ----------
panel_26 = Panel(ecom_self_sufficiency.grid_export)  # disabled

boolean_toggle_3 = BooleanToggle(False)  # disabled
panel_27 = Panel("0-20")  # disabled
load_gen_profile = LoadGenerationProfiling(community=energycommunity.community, analysis_period=panel_27, run=boolean_toggle_3)  # -> out, report, load_profile, generation_profile, profile_df; disabled
# ---------- load_gen_profile: Python ----------
# Load & Generation Profiling: Energy Community (MIT)
# Version: 0.0.2
# Designed for use inside Grasshopper (GH) for Rhino by ECOM4Future

"""
Analyze load (demand) and generation (PV production) profiles of an Energy Community.

    Args:
        community: Energy Community object (from Merge ECOM Entities).
        analysis_period: Flexible analysis period:
            - None = full year (default)
            - [start_hour, end_hour] (0–8759)
            - ["YYYY-MM-DD", "YYYY-MM-DD"]
            - ["YYYY-MM-DD HH:MM", "YYYY-MM-DD HH:MM"]

    Returns:
        report: Summary of demand, generation, and self-consumption ratio.
        load_profile: Hourly demand profile (list).
        generation_profile: Hourly PV generation profile (list).
        profile_df: List of dicts [{hour, load, generation}] for CSV/export.
"""

ghenv.Component.Name = 'Load & Generation Profiling'
ghenv.Component.NickName = 'load_gen_profile'
ghenv.Component.Message = '0.0.2'
ghenv.Component.Category = 'ECOM4Future'
ghenv.Component.SubCategory = '5 :: Energy Community'
ghenv.Component.AdditionalHelpFromDocStrings = '2'

import numpy as np
import pandas as pd

try:
    from ladybug_rhino.grasshopper import all_required_inputs
except ImportError:
    def all_required_inputs(comp): return True


class LoadGenerationProfiler:
    def __init__(self, community, analysis_period=None):
        self.community = community
        self.start_hour, self.end_hour = self._parse_analysis_period(analysis_period)

        self.load_profile = self._build_load_profile()
        self.generation_profile = self._build_generation_profile()

        self.load_profile = self.load_profile[self.start_hour:self.end_hour + 1]
        self.generation_profile = self.generation_profile[self.start_hour:self.end_hour + 1]

    def _parse_analysis_period(self, period):
        if not period:
            return 0, 8759
        try:
            if all(isinstance(p, (int, float)) for p in period):
                return int(period[0]), int(period[1])
            if all(isinstance(p, str) for p in period):
                start = pd.to_datetime(period[0])
                end = pd.to_datetime(period[1])
                start_hour = (start.dayofyear - 1) * 24 + start.hour
                end_hour = (end.dayofyear - 1) * 24 + end.hour
                return int(start_hour), int(end_hour)
        except:
            pass
        return 0, 8759

    def _build_load_profile(self):
        profile = np.zeros(8760)
        for b in self.community.building:
            if isinstance(b.electric_demand, list) and len(b.electric_demand) == 8760:
                profile += np.array(b.electric_demand)
            else:
                profile += np.full(8760, b.total_energy_demand / 8760.0)
        return profile

    def _build_generation_profile(self):
        profile = np.zeros(8760)
        for b in self.community.building:
            for pv in getattr(b, "PV_plant", []):
                if hasattr(pv, "hourly_production"):
                    profile += np.array(pv.hourly_production)
                else:
                    profile += np.full(8760, (pv.total_power / 1000.0) * 1000 / 8760.0)
        for pv in self.community.PV_plant:
            if hasattr(pv, "hourly_production"):
                profile += np.array(pv.hourly_production)
            else:
                profile += np.full(8760, (pv.total_power / 1000.0) * 1000 / 8760.0)
        return profile

    def validate(self):
        total_load = np.sum(self.load_profile)
        total_gen = np.sum(self.generation_profile)
        self_consumption = 100 * min(total_gen, total_load) / total_gen if total_gen > 0 else 0
        return (f"Load & Generation Profiling Complete.\n"
                f"Total Load: {total_load:.1f} kWh | Total Generation: {total_gen:.1f} kWh\n"
                f"Self-Consumption Ratio: {self_consumption:.1f}%")

    def profile_dataframe(self):
        return [{"hour": i, "load": l, "generation": g}
                for i, (l, g) in enumerate(zip(self.load_profile, self.generation_profile))]


# --- Main Grasshopper Logic ---
if all_required_inputs(ghenv.Component):
    profiler = LoadGenerationProfiler(community, analysis_period)
    report = profiler.validate()
    load_profile = profiler.load_profile
    generation_profile = profiler.generation_profile
    profile_df = profiler.profile_dataframe()
# ---------- end load_gen_profile ----------
panel_28 = Panel(load_gen_profile.profile_df)  # disabled

boolean_toggle_4 = BooleanToggle(False)  # disabled
ecom_grid_analysis = ECOMGridInteractionAnalysis(
    community=energycommunity.community,
    hourly_dispatch=ecom_dispatcher.grid_import,
    electricity_market_price=nordpool_price.prices,
    run=boolean_toggle_4)  # -> out, report, total_import_cost, total_export_revenue, net_balance, peak_import_hour, peak_export_hour, hourly_grid_metrics; disabled
# ---------- ecom_grid_analysis: Python ----------
#! python3
# r: numpy, pandas
import numpy as np
import pandas as pd

# ECOM Grid Interaction Analysis (MIT)
# Version: 0.0.3 (Updated for hourly_dispatch input from ECOM Dispatcher)
# Designed for use inside Grasshopper (GH) for ECOM4Future

"""
Analyze grid imports/exports and calculate economic balance for the energy community.

    Args:
        run: Boolean toggle to execute analysis.
        hourly_dispatch: Output from ECOM Dispatcher (list of hourly dicts or table).
        electricity_market_price: Float, list, or CSV/Series (SEK/kWh).
        feed_in_tariff: (Optional) Fixed price for selling energy to the grid (SEK/kWh).
        analysis_period: Optional [start_hour, end_hour] range (0–8759).

    Returns:
        report: Summary of import/export economics.
        total_import_cost: Total cost of grid imports (SEK).
        total_export_revenue: Total revenue from grid exports (SEK).
        net_balance: Revenue - Cost (SEK).
        peak_import_hour: Hour with highest grid import.
        peak_export_hour: Hour with highest grid export.
        hourly_grid_metrics: List of hourly records:
            {hour, import_kwh, export_kwh, cost, revenue}.
"""

ghenv.Component.Name = 'ECOM Grid Interaction Analysis'
ghenv.Component.NickName = 'ECOM_grid_analysis'
ghenv.Component.Message = '0.0.3'
ghenv.Component.Category = 'ECOM4Future'
ghenv.Component.SubCategory = '6 :: Energy Community Analysis'
ghenv.Component.AdditionalHelpFromDocStrings = '2'

try:
    from ladybug_rhino.grasshopper import all_required_inputs
except ImportError:
    def all_required_inputs(comp): return True


class ECOMGridInteraction:
    def __init__(self, hourly_dispatch, electricity_market_price, feed_in_tariff=None, analysis_period=None):
        # ✅ Ensure dispatcher output is converted to consistent list of dicts
        self.hourly_dispatch = self._normalize_dispatch(hourly_dispatch)
        self.prices = self._prepare_price(electricity_market_price)
        self.feed_in_tariff = feed_in_tariff if feed_in_tariff is not None else np.mean(self.prices) * 0.8
        self.start_hour, self.end_hour = self._prepare_period(analysis_period)
        self.hours = np.arange(self.start_hour, self.end_hour + 1)

        # Extract imports/exports (fallback to 0 if missing)
        self.hourly_import = np.array([h.get("grid_import", 0.0) for h in self.hourly_dispatch])
        self.hourly_export = np.array([h.get("grid_export", 0.0) for h in self.hourly_dispatch])

        # Restrict to analysis period
        self.hourly_import = self.hourly_import[self.start_hour:self.end_hour + 1]
        self.hourly_export = self.hourly_export[self.start_hour:self.end_hour + 1]
        self.prices = self.prices[self.start_hour:self.end_hour + 1]

        # Outputs
        self.total_import_cost = 0.0
        self.total_export_revenue = 0.0
        self.net_balance = 0.0
        self.results = pd.DataFrame()

    def _normalize_dispatch(self, dispatch):
        """Ensure input is a list of dicts regardless of GH output type."""
        if isinstance(dispatch, pd.DataFrame):
            return dispatch.to_dict("records")
        if isinstance(dispatch, list) and all(isinstance(d, dict) for d in dispatch):
            return dispatch
        if isinstance(dispatch, list) and all(isinstance(d, (list, tuple)) for d in dispatch):
            # Assume table-like: [hour, grid_import, grid_export,...]
            return [
                {"hour": row[0], "grid_import": row[4] if len(row) > 4 else 0.0,
                 "grid_export": row[5] if len(row) > 5 else 0.0}
                for row in dispatch
            ]
        raise TypeError("hourly_dispatch must be a list of dicts, a table-like list, or a DataFrame.")

    def _prepare_price(self, price):
        if isinstance(price, (int, float)):
            return np.full(8760, float(price))
        elif isinstance(price, list):
            return np.array(price)
        elif isinstance(price, pd.Series):
            return price.values
        elif isinstance(price, pd.DataFrame) and "price" in price.columns:
            return price["price"].values
        else:
            raise TypeError("electricity_market_price must be float, list, Series, or DataFrame with 'price' column.")

    def _prepare_period(self, period):
        if period and len(period) == 2:
            return max(0, period[0]), min(period[1], 8759)
        return 0, 8759

    def run(self):
        cost = self.hourly_import * self.prices
        revenue = self.hourly_export * self.feed_in_tariff

        self.total_import_cost = cost.sum()
        self.total_export_revenue = revenue.sum()
        self.net_balance = self.total_export_revenue - self.total_import_cost

        self.results = pd.DataFrame({
            "hour": self.hours,
            "import_kwh": self.hourly_import,
            "export_kwh": self.hourly_export,
            "cost": cost,
            "revenue": revenue
        })

    def validate(self):
        if self.results.empty:
            return "No data available for analysis."
        peak_import_hour = self.results.iloc[self.results["import_kwh"].idxmax()]["hour"]
        peak_export_hour = self.results.iloc[self.results["export_kwh"].idxmax()]["hour"]

        return (f"ECOM Grid Interaction Analysis complete.\n"
                f"Total Import Cost: {self.total_import_cost:.1f} SEK | "
                f"Total Export Revenue: {self.total_export_revenue:.1f} SEK | "
                f"Net Balance: {self.net_balance:.1f} SEK\n"
                f"Peak Import Hour: {peak_import_hour} | Peak Export Hour: {peak_export_hour}")


# --- Grasshopper Main Logic ---
if all_required_inputs(ghenv.Component) and run:
    grid_analysis = ECOMGridInteraction(hourly_dispatch, electricity_market_price, feed_in_tariff, analysis_period)
    grid_analysis.run()

    report = grid_analysis.validate()
    total_import_cost = grid_analysis.total_import_cost
    total_export_revenue = grid_analysis.total_export_revenue
    net_balance = grid_analysis.net_balance
    peak_import_hour = int(grid_analysis.results["hour"][grid_analysis.results["import_kwh"].idxmax()])
    peak_export_hour = int(grid_analysis.results["hour"][grid_analysis.results["export_kwh"].idxmax()])
    hourly_grid_metrics = grid_analysis.results.to_dict("records")
else:
    report = "Toggle 'run' to True to execute the grid analysis."
    total_import_cost = total_export_revenue = net_balance = 0
    peak_import_hour = peak_export_hour = None
    hourly_grid_metrics = []
# ---------- end ecom_grid_analysis ----------
panel_29 = Panel(ecom_grid_analysis.peak_export_hour)  # disabled

panel_30 = Panel(ecom_dispatcher.grid_import)

boolean_toggle_5 = BooleanToggle(False)  # disabled
ecom_battery_utilization = ECOMBatteryUtilization(community=energycommunity.community, battery_soc=ecom_dispatcher.battery_soc, run=boolean_toggle_5)  # -> out, report, hourly_battery_metrics, avg_daily_cycles, avg_soc, max_soc, min_soc; disabled
# ---------- ecom_battery_utilization: Python ----------
# ECOM Battery Utilization Analysis (MIT)
# Version: 0.0.2 (Supports battery_soc override from Dispatcher)
# Designed for use inside Grasshopper (GH) for Rhino by ECOM4Future

"""
Analyze battery utilization patterns in the Energy Community.

Priority:
- If battery_soc (from Dispatcher) is connected → use it directly.
- Else → estimate based on community batteries (roughly constant or no cycles).

Args:
    run: Boolean toggle to execute simulation.
    community: Energy Community object (from Merge ECOM Entities).
    battery_soc: (Optional) Hourly SOC list from ECOM_dispatcher (list of lists).
    analysis_period: Optional [start_hour, end_hour] range (0–8759).

Returns:
    report: Summary of battery utilization.
    hourly_battery_metrics: List of dicts [{hour, avg_soc, cycles_estimated}]
    avg_daily_cycles: Average daily charge/discharge cycles per battery.
    avg_soc: Average SOC across period (%).
    max_soc: Maximum SOC observed (%).
    min_soc: Minimum SOC observed (%).
"""

ghenv.Component.Name = 'ECOM Battery Utilization'
ghenv.Component.NickName = 'ECOM_battery_utilization'
ghenv.Component.Message = '0.0.2'
ghenv.Component.Category = 'ECOM4Future'
ghenv.Component.SubCategory = '5 :: Energy Community'
ghenv.Component.AdditionalHelpFromDocStrings = '2'

import numpy as np
import pandas as pd

try:
    from ladybug_rhino.grasshopper import all_required_inputs
except ImportError:
    def all_required_inputs(comp): return True


class BatteryUtilization:
    def __init__(self, community, analysis_period=None, battery_soc=None):
        self.community = community
        self.start_hour, self.end_hour = self._prepare_period(analysis_period)
        self.hours = np.arange(self.start_hour, self.end_hour + 1)
        self.n_hours = len(self.hours)

        # SOC data (priority to Dispatcher SOC)
        self.soc_matrix = self._prepare_soc(battery_soc)
        self.avg_soc_profile = self.soc_matrix.mean(axis=1) if self.soc_matrix.size > 0 else np.zeros(self.n_hours)

        # Results
        self.hourly_metrics = []
        self.avg_daily_cycles = 0.0
        self.avg_soc = 0.0
        self.max_soc = 0.0
        self.min_soc = 0.0

    def _prepare_period(self, period):
        if period and len(period) == 2:
            return max(0, period[0]), min(period[1], 8759)
        return 0, 8759

    def _prepare_soc(self, soc_input):
        """Use Dispatcher SOC if provided, else estimate from community."""
        if soc_input is not None and isinstance(soc_input, list) and len(soc_input) > 0:
            # Convert to numpy array (hour x battery)
            return np.array(soc_input)
        else:
            # Fallback: Approximate SOC (static at 50% if no dispatcher run)
            capacities = self._get_battery_capacities()
            return np.full((self.n_hours, len(capacities)), 0.5 * np.array(capacities)) if capacities else np.zeros((self.n_hours, 1))

    def _get_battery_capacities(self):
        caps = []
        for b in self.community.building:
            for bat in getattr(b, "Battery", []):
                caps.append(bat.capacity)
        for bat in self.community.battery:
            caps.append(bat.capacity)
        return caps

    def run(self):
        if self.soc_matrix.size == 0:
            return

        # Calculate cycles (roughly based on SOC fluctuation amplitude)
        delta_soc = np.abs(np.diff(self.soc_matrix, axis=0))
        cycles_per_battery = delta_soc.sum(axis=0) / (2 * self.soc_matrix.max(axis=0))
        self.avg_daily_cycles = cycles_per_battery.mean() / (self.n_hours / 24.0)

        # Aggregate SOC statistics
        self.avg_soc = self.avg_soc_profile.mean()
        self.max_soc = self.avg_soc_profile.max()
        self.min_soc = self.avg_soc_profile.min()

        # Hourly report
        for idx, hour in enumerate(self.hours):
            self.hourly_metrics.append({
                "hour": int(hour),
                "avg_soc": float(self.avg_soc_profile[idx]),
                "cycles_estimated": float(delta_soc[idx - 1].mean()) if idx > 0 else 0
            })

    def validate(self):
        source = "Dispatcher SOC" if self.soc_matrix.size > 0 else "Community (estimated)"
        return (f"ECOM Battery Utilization complete.\n"
                f"Data Source: {source}\n"
                f"Avg SOC: {self.avg_soc:.1f}% | Max SOC: {self.max_soc:.1f}% | Min SOC: {self.min_soc:.1f}%\n"
                f"Avg Daily Cycles: {self.avg_daily_cycles:.2f}")


# --- Grasshopper Main Logic ---
if all_required_inputs(ghenv.Component) and run:
    analyzer = BatteryUtilization(community, analysis_period, battery_soc)
    analyzer.run()

    report = analyzer.validate()
    hourly_battery_metrics = analyzer.hourly_metrics
    avg_daily_cycles = analyzer.avg_daily_cycles
    avg_soc = analyzer.avg_soc
    max_soc = analyzer.max_soc
    min_soc = analyzer.min_soc
else:
    report = "Toggle 'run' to True to execute battery utilization analysis."
    hourly_battery_metrics, avg_daily_cycles, avg_soc, max_soc, min_soc = [], 0, 0, 0, 0
# ---------- end ecom_battery_utilization ----------
panel_31 = Panel(ecom_battery_utilization.report)  # disabled

boolean_toggle_6 = BooleanToggle(False)  # disabled
ecom_scenario_comparison = ECOMScenarioComparison(scenarios=ecom_dispatcher.hourly_dispatch, run=boolean_toggle_6)  # -> out, report, comparison_table, best_performance; disabled
# ---------- ecom_scenario_comparison: Python ----------
# ECOM Scenario Comparison (MIT)
# Version: 0.0.1
# Designed for use inside Grasshopper (GH) for Rhino by ECOM4Future

"""
Compare multiple energy community dispatch scenarios based on key KPIs.

Args:
    run: Boolean toggle to execute analysis.
    scenarios: List of hourly_dispatch outputs from ECOM_dispatcher (one per scenario).
    scenario_names: Optional list of scenario names (must match length of scenarios).
    analysis_period: Optional [start_hour, end_hour] range (0–8759).

Returns:
    report: Text summary comparing scenarios.
    comparison_table: List of dicts [{scenario, self_sufficiency, self_consumption, total_cost, total_revenue, net_balance, total_carbon_imported}]
    best_performance: Scenario name with highest self-sufficiency.
"""

ghenv.Component.Name = 'ECOM Scenario Comparison'
ghenv.Component.NickName = 'ECOM_scenario_comparison'
ghenv.Component.Message = '0.0.1'
ghenv.Component.Category = 'ECOM4Future'
ghenv.Component.SubCategory = '6 :: Energy Community Analysis'
ghenv.Component.AdditionalHelpFromDocStrings = '2'

import numpy as np
import pandas as pd

try:
    from ladybug_rhino.grasshopper import all_required_inputs
except ImportError:
    def all_required_inputs(comp): return True

class ECOMScenarioComparison:
    def __init__(self, scenarios, scenario_names=None, analysis_period=None):
        self.scenarios = scenarios
        self.names = scenario_names if scenario_names and len(scenario_names) == len(scenarios) else [f"Scenario_{i+1}" for i in range(len(scenarios))]
        self.start_hour, self.end_hour = self._prepare_period(analysis_period)
        self.results = []

    def _prepare_period(self, period):
        if period and len(period) == 2:
            return max(0, period[0]), min(period[1], 8759)
        return 0, 8759

    def run(self):
        for name, sc in zip(self.names, self.scenarios):
            df = pd.DataFrame(sc)
            df = df.iloc[self.start_hour:self.end_hour + 1]

            total_pv = df["pv_used"].sum() + df["p2p_energy"].sum() + df["grid_export"].sum()
            total_demand = df["pv_used"].sum() + df["battery_discharge"].sum() + df["grid_import"].sum()
            total_import = df["grid_import"].sum()
            total_export = df["grid_export"].sum()

            self_sufficiency = 100 * (1 - total_import / total_demand) if total_demand > 0 else 0
            self_consumption = 100 * ((total_pv - total_export) / total_pv) if total_pv > 0 else 0
            total_cost = (df["grid_import"] * 1).sum()  # assumes cost already applied in dispatcher if needed
            total_revenue = df["p2p_energy"].sum() + df["grid_export"].sum()
            net_balance = total_revenue - total_cost
            total_carbon = df.get("grid_import", pd.Series()).sum()  # fallback, will be extended later for carbon intensity

            self.results.append({
                "scenario": name,
                "self_sufficiency": round(self_sufficiency, 1),
                "self_consumption": round(self_consumption, 1),
                "total_cost": round(total_cost, 1),
                "total_revenue": round(total_revenue, 1),
                "net_balance": round(net_balance, 1),
                "total_carbon_imported": round(total_carbon, 1)
            })

    def validate(self):
        if not self.results:
            return "No scenarios analyzed."
        best = max(self.results, key=lambda x: x["self_sufficiency"])
        lines = [f"{r['scenario']}: SS={r['self_sufficiency']}%, Cost={r['total_cost']} SEK, Carbon={r['total_carbon_imported']} kgCO₂" for r in self.results]
        return f"ECOM Scenario Comparison complete.\nBest Scenario: {best['scenario']} (highest self-sufficiency)\n" + "\n".join(lines)

# --- Grasshopper Main Logic ---
if all_required_inputs(ghenv.Component) and run:
    comparison = ECOMScenarioComparison(scenarios, scenario_names, analysis_period)
    comparison.run()

    report = comparison.validate()
    comparison_table = comparison.results
    best_performance = max(comparison.results, key=lambda x: x["self_sufficiency"])["scenario"] if comparison.results else None
else:
    report = "Toggle 'run' to True to execute the scenario comparison."
    comparison_table, best_performance = [], None
# ---------- end ecom_scenario_comparison ----------
panel_32 = Panel(ecom_scenario_comparison.report)  # disabled
